# Dynamo custom node BestChromosome.dyf (Dynamo 1.3.3.4111)
# category: Evo.GeneticAlgorithms.Chromosomes
# Returns the best chromosome from a generation basing on fitness function.

generation = Input()  # List of individuals to evaluate fitness function for.
# note: Evo   Genetic Algorithms for Dynamo
#    2019
# Created by: Marcin Jasiński
# marcin.jasinski@polsl.pl
# Silesian University of Technology
# Department of Mechanics and Bridges
# Gliwice, Poland
# Repository: github.com/majasinski/Evo
# note: Integral part of the solution is GeneticSharp library by Diego Giacomelli:
# github.com/giacomelli/GeneticSharp
fitnessFunction = Input()  # Fitness function defined in a DYF node and passed to be evaluated by genetic algorithm.
apply = ApplyFunction(fitnessFunction, generation)  # "Function.Apply"
boolean = BoolSelector(false)
sortIndexByValue = SortIndexByValue(apply, boolean)
firstItem = List.FirstItem(sortIndexByValue)
getItemAtIndex = List.GetItemAtIndex(list=generation, index=firstItem)
bestChromosome = Output(getItemAtIndex)  # The best chromosome in the generation.
getItemAtIndex_2 = List.GetItemAtIndex(list=apply, index=firstItem)
fitness = Output(getItemAtIndex_2)  # Fitness function value evaluated for the best chromosome.
