# Dynamo custom node TravellingSalesmanProblem.dyf (Dynamo 1.3.3.4111)
# category: Evo.GeneticAlgorithms
# Evaluates distance between points (cities) in a classing Travelling Salesman Problem.

cities = Input()  # A list of points (cities).
route = Input()  # A solution candidate.

# group: Creating a closed route.
getItemAtIndex = List.GetItemAtIndex(list=cities, index=route)
boolean = BoolSelector(true)
byPoints = PolyCurve.ByPoints(points=getItemAtIndex, connectLastToFirst=boolean)
length = Curve.Length(byPoints)

# group: Calculating fitness function values.
number = DoubleInput(1)
number_2 = DoubleInput(1000)
count = Count(cities)
mul = number_2 * count
div = length / mul
sub = number - div
fitness = Output(sub)  # Normalized fitness function value.

distance = Output(length)  # Real travel distance.
routeCurve = Output(byPoints)  # A visualization of the route.
