# Dynamo custom node Evo.ContinueWhile.dyf (Dynamo 1.3.3.4111)
# category: Evo.GeneticAlgorithms.Basic
# Termines evaluation of genetic algorithm if termination conditions are met.

# note: Evo   Genetic Algorithms for Dynamo
#    2019
# Created by: Marcin Jasiński
# marcin.jasinski@polsl.pl
# Silesian University of Technology
# Department of Mechanics and Bridges
# Gliwice, Poland
# Repository: github.com/majasinski/Evo
# note: Integral part of the solution is GeneticSharp library by Diego Giacomelli:
# github.com/giacomelli/GeneticSharp
init = Input()  # Please do not connect any node to this input.
firstItem = List.FirstItem(init)
continueWhile = Output(firstItem)  # ContinueWhile output function to be passed to a LoopWhile node.
