# Dynamo custom node Evo.Init.dyf (Dynamo 1.3.3.4111)
# category: Evo.GeneticAlgorithms.Basic
# Creates init input for evaluation of genetic algorithms using LoopWhile node and Evo package.

# note: Integral part of the solution is GeneticSharp library by Diego Giacomelli:
# github.com/giacomelli/GeneticSharp
# note: Evo   Genetic Algorithms for Dynamo
#    2019
# Created by: Marcin Jasiński
# marcin.jasinski@polsl.pl
# Silesian University of Technology
# Department of Mechanics and Bridges
# Gliwice, Poland
# Repository: github.com/majasinski/Evo
keepEvolving = Input(keepEvolving:bool = true)  # Whether new iteration should be processed.
algorithm = Input()  # A genetic algorithm instance to be evaluated.
create = List.Create(keepEvolving, algorithm)
init = Output(create)  # Init output list to be passed to a LoopWhile node (do not connect this node to Evo.ContinueWhile and Evo.LoopWhile nodes).
