# Dynamo custom node Evo.LoopBody.dyf (Dynamo 1.3.3.4111)
# category: Evo.GeneticAlgorithms.Basic
# Definition of evaluation body for a genetic algorithm instance, iterated by LoopWhile and Evo package.

# note: Integral part of the solution is GeneticSharp library by Diego Giacomelli:
# github.com/giacomelli/GeneticSharp
# note: Evo   Genetic Algorithms for Dynamo
#    2019
# Created by: Marcin Jasiński
# marcin.jasinski@polsl.pl
# Silesian University of Technology
# Department of Mechanics and Bridges
# Gliwice, Poland
# Repository: github.com/majasinski/Evo
init = Input()  # Please do not connect any node to this input.
lastItem = List.LastItem(init)
fitnessFunction = Input()  # Fitness function defined in a DYF node, passed to be evaluated by genetic algorithm.

# group: 1. Retrieving population from a genetic algorithm instance, 2. Retrieving most recent generation out of population, 3. Applying fitness function evaluator to individuals from the most recent generation, 4. Iterating the genetic algorithm instance by one.
getPopulation = GeneticAlgorithms.Populations.GetPopulation(lastItem)
getCurrentGeneration = GeneticAlgorithms.Populations.GetCurrentGeneration(getPopulation)
apply = ApplyFunction(fitnessFunction, getCurrentGeneration)  # "Function.Apply"
evolveGeneration = GeneticAlgorithms.Basic.EvolveGeneration(lastItem, apply)

# group: Checking for loop termination: a) Genetic algorithm termination conditions met, or, b) Unhandled error occured.
hasFinished = GeneticAlgorithms.Basic.HasFinished(evolveGeneration)
isNull = Object.IsNull(evolveGeneration)
or_ = Or(hasFinished, isNull)
not_ = Not(or_)

create = List.Create(not_, evolveGeneration)
loopBody = Output(create)  # LoopBody output function to be passed to a LoopWhile node.
