# Dynamo graph Evo. AckleyFunction.dyn (Dynamo 1.3.3.4111)

# group: Creating a chromosome pattern: the maximum of the modified Ackley function is looked within the square range of values: 0.0 to 200.0.
# note: PROBLEM DESCRIPTION
# The Ackley function is a non-convex, two-variable function used as a performance test for optimization algorithms, originally proposed by David Ackley in 1987.
# The function is characterized by numerous local optima and only one global minimum at f(0, 0) = 0. In the sample, a modified version of the Ackley function was used - the whole plot has been moved towards positive quadrant of the X-Y coordinate system to exclude negative variables out of the search area. Such the operation reduces required length of endcoded chromosomes and enhance the convergence rate.
# Also, considering the fact that the package is designed to look for global maxima, function results are multiplied by -1 to search for global maximum, instead of the global minimum.
# Finally, after modifications, the global minimum can be expected at f(100, 100) = 0.
min = DoubleInput(0)
# note: Detailed description of the sample is included in the Evo package folder, by default:
# %APPDATA%\Dynamo\Dynamo Core [or Dynamo Revit]\1.3 [or 2.0]\packages\Evo\extra
# Look for: Evo First Steps.pdf
# note: Evo   Genetic Algorithms for Dynamo
#    2019
# Created by: Marcin Jasiński
# marcin.jasinski@polsl.pl
# Silesian University of Technology
# Department of Mechanics and Bridges
# Gliwice, Poland
# Repository: github.com/majasinski/Evo
create = List.Create(min, min)
max = DoubleInput(200)
create_2 = List.Create(max, max)
fractionDigits = DoubleInput(1)
create_3 = List.Create(fractionDigits, fractionDigits)
createFloatingPointChromosome = GeneticAlgorithms.Chromosomes.CreateFloatingPointChromosome(create, create_2, create_3)

# group: Generating initial population of the given size.
size = DoubleInput(100)
trackingStrategy = GeneticAlgorithms.PopulationStrategies.TrackingStrategy()
generatePopulation = GeneticAlgorithms.Populations.GeneratePopulation(size, createFloatingPointChromosome, trackingStrategy)

# group: Creating a genetic algorithm instance. The core of the solution is the built-in LoopWhile node that iterates the genetic algorithm instance and produces new generations basing on Evo.LoopBody.
tournamentSelection = GeneticAlgorithms.Selections.TournamentSelection()
votingRecombinationCrossover = GeneticAlgorithms.Crossovers.VotingRecombinationCrossover()
number = DoubleInput(0.01)
createGeneticAlgorithm = GeneticAlgorithms.Basic.CreateGeneticAlgorithm(generatePopulation, tournamentSelection, votingRecombinationCrossover, arg5=size, arg7=number)
init = Custom[Evo.Init](algorithm=createGeneticAlgorithm)  # Creates init input for evaluation of genetic algorithms using LoopWhile node and Evo package.
continueWhile = Custom[Evo.ContinueWhile]()  # Termines evaluation of genetic algorithm if termination conditions are met.; unwired: init
ackleyFunction = Custom[AckleyFunction]()  # A non-convex Ackley function.; unwired: candidate
loopBody = Custom[Evo.LoopBody](fitnessFunction=ackleyFunction)  # Definition of evaluation body for a genetic algorithm instance, iterated by LoopWhile and Evo package.; unwired: init
loopWhile = LoopWhile(init, continueWhile, loopBody)

# group: Obtaining the best solution. Calculating the line length for the best solution.
lastItem = List.LastItem(loopWhile)
getPopulation = GeneticAlgorithms.Populations.GetPopulation(lastItem)
getCurrentGeneration = GeneticAlgorithms.Populations.GetCurrentGeneration(getPopulation)
bestChromosome = Custom[BestChromosome](generation=getCurrentGeneration, fitnessFunction=ackleyFunction)  # Returns the best chromosome from a generation basing on fitness function.
timeEvolving = GeneticAlgorithms.Basic.TimeEvolving(lastItem)
# note: Total evolving time, number of created generations and progressive generations are inspected.
generationsNumber = GeneticAlgorithms.Populations.GenerationsNumber(lastItem)
getProgressiveGenerations = GeneticAlgorithms.Populations.GetProgressiveGenerations(getPopulation)
ackleyFunction_2 = Custom[AckleyFunction](candidate=getProgressiveGenerations)

# note: Members of the initial population are obtained here and passed to the fitness function to:
# a) check if the fitness function works correctly,
# b) get a reference material to compare with the final solution.
getInitialGeneration = GeneticAlgorithms.Populations.GetInitialGeneration(generatePopulation)
ackleyFunction_3 = Custom[AckleyFunction](candidate=getInitialGeneration)
