# Dynamo graph Evo. TravellingSalesmanProblem.dyn (Dynamo 1.3.3.4111)

# note: PROBLEM DESCRIPTION
# The Travelling Salesman Problem (TSP) is a classical NP-hard combinational problem.
# Its input is a list of cities, in this case expressed in the form of points list. The optimization task is to find the closest path between the points with no repetitions. The problem is visualized by a salesman who travels between the cities but during the route he cannot enter the same city twice and his path should form a closed curve.
# The presented sample utilizes operations on graphical Dynamo object.
# note: Evo   Genetic Algorithms for Dynamo
#    2019
# Created by: Marcin Jasiński
# marcin.jasinski@polsl.pl
# Silesian University of Technology
# Department of Mechanics and Bridges
# Gliwice, Poland
# Repository: github.com/majasinski/Evo

# group: Creating a chromosome pattern: a random sequence of city indices (a random route the salesman will travel). List of indices was also extracted for reference purposes. To view the proposed route, enable preview of the TravellingSalesmanProblem node:
cities = CodeBlock()
# ---------- cities.designscript (34 lines) ----------
//In case of errors in newer Dynamo versions,
//replace { } with [ ].
{
  //Point 0:
Point.ByCoordinates(256, 688),
  //Point 1:
Point.ByCoordinates(590, 706),
  //Point 2:
Point.ByCoordinates(618, 685),
  //Point 3:
Point.ByCoordinates(461, 398),
  //Point 4:
Point.ByCoordinates(859, 583),
  //Point 5:
Point.ByCoordinates(220, 288),
  //Point 6:
Point.ByCoordinates(275, 260),
  //Point 7:
Point.ByCoordinates(461, 561),
  //Point 8:
Point.ByCoordinates(795, 711),
  //Point 9:
Point.ByCoordinates(631, 403),
  //Point 10:
Point.ByCoordinates(330, 730),
  //Point 11:
Point.ByCoordinates(273, 554),
  //Point 12:
Point.ByCoordinates(703, 490),
  //Point 13:
Point.ByCoordinates(179, 499),
  //Point 14:
Point.ByCoordinates(693, 750)
};
# ----------------------------------------
# note: Detailed description of the sample is included in the Evo package folder, by default:
# %APPDATA%\Dynamo\Dynamo Core [or Dynamo Revit]\1.3 [or 2.0]\packages\Evo\extra
# Look for: Evo First Steps.pdf
count = Count(cities)
createOrderedChromosome = GeneticAlgorithms.Chromosomes.CreateOrderedChromosome(count)
getGenes = GeneticAlgorithms.Chromosomes.GetGenes(createOrderedChromosome)
travellingSalesmanProblem = Custom[TravellingSalesmanProblem](route=getGenes, cities=cities)  # Evaluates distance between points (cities) in a classing Travelling Salesman Problem.

# group: Generating initial population of the given size.
size = DoubleInput(100)
trackingStrategy = GeneticAlgorithms.PopulationStrategies.TrackingStrategy()
generatePopulation = GeneticAlgorithms.Populations.GeneratePopulation(size, createOrderedChromosome, trackingStrategy)

# group: Creating a genetic algorithm instance. The core of the solution is the built-in LoopWhile node that iterates the genetic algorithm instance and produces new generations basing on Evo.LoopBody.
rouletteWheelSelection = GeneticAlgorithms.Selections.RouletteWheelSelection()
orderedCrossover = GeneticAlgorithms.Crossovers.OrderedCrossover()
reverseSequenceMutation = GeneticAlgorithms.Mutations.ReverseSequenceMutation()
createGeneticAlgorithm = GeneticAlgorithms.Basic.CreateGeneticAlgorithm(generatePopulation, rouletteWheelSelection, orderedCrossover, reverseSequenceMutation, arg5=size)
init = Custom[Evo.Init](algorithm=createGeneticAlgorithm)  # Creates init input for evaluation of genetic algorithms using LoopWhile node and Evo package.
continueWhile = Custom[Evo.ContinueWhile]()  # Termines evaluation of genetic algorithm if termination conditions are met.; unwired: init
travellingSalesmanProblem_2 = Custom[TravellingSalesmanProblem](cities=cities)  # unwired: route
loopBody = Custom[Evo.LoopBody](fitnessFunction=travellingSalesmanProblem_2.fitness)  # Definition of evaluation body for a genetic algorithm instance, iterated by LoopWhile and Evo package.; unwired: init
loopWhile = LoopWhile(init, continueWhile, loopBody)

# group: Obtaining the best solution. Calculating the total travel distance for the best route.
lastItem = List.LastItem(loopWhile)
timeEvolving = GeneticAlgorithms.Basic.TimeEvolving(lastItem)
getPopulation = GeneticAlgorithms.Populations.GetPopulation(lastItem)
getCurrentGeneration = GeneticAlgorithms.Populations.GetCurrentGeneration(getPopulation)
bestChromosome = Custom[BestChromosome](generation=getCurrentGeneration, fitnessFunction=travellingSalesmanProblem_2.fitness)  # Returns the best chromosome from a generation basing on fitness function.
travellingSalesmanProblem_3 = Custom[TravellingSalesmanProblem](route=bestChromosome.bestChromosome, cities=cities)
