# Dynamo custom node AckleyFunction.dyf (Dynamo 1.3.3.4111)
# category: Evo.GeneticAlgorithms
# A non-convex Ackley function.

number = DoubleInput(-20)
number_2 = DoubleInput(-0.2)
candidate = Input()  # A solution candidate.
firstItem = List.FirstItem(candidate@L2)
number_3 = DoubleInput(2)
pow = Math.Pow(number=firstItem, power=number_3)
lastItem = List.LastItem(candidate@L2)
pow_2 = Math.Pow(number=lastItem, power=number_3)
add = pow + pow_2
sqrt = Math.Sqrt(add)
mul = number_2 * sqrt
exp = Math.Exp(mul)
mul_2 = number * exp
number_4 = DoubleInput(0.5)
piTimes2 = Math.PiTimes2()
mul_3 = piTimes2 * firstItem
radiansToDegrees = Math.RadiansToDegrees(mul_3)
cos = Math.Cos(radiansToDegrees)
mul_4 = piTimes2 * lastItem
radiansToDegrees_2 = Math.RadiansToDegrees(mul_4)
cos_2 = Math.Cos(radiansToDegrees_2)
add_2 = cos + cos_2
mul_5 = number_4 * add_2
exp_2 = Math.Exp(mul_5)
sub = mul_2 - exp_2
E = Math.E()
add_3 = sub + E
sub_2 = add_3 - number
number_5 = DoubleInput(-1)
mul_6 = sub_2 * number_5
func = Output(mul_6)  # Ackley function value for the solution candidate.
