# Dynamo custom node Evo.LoopBody.dyf (Dynamo 1.3.3.4111)
# category: Evo.GeneticAlgorithms.Basic
# Definition of evaluation body for a genetic algorithm instance, iterated by LoopWhile and Evo package.

# note: Integral part of the solution is GeneticSharp library by Diego Giacomelli:
# github.com/giacomelli/GeneticSharp
# note: Evo   Genetic Algorithms for Dynamo
#    2019
# Created by: Marcin Jasiński
# marcin.jasinski@polsl.pl
# Silesian University of Technology
# Department of Mechanics and Bridges
# Gliwice, Poland
# Repository: github.com/majasinski/Evo
init = Input()  # Please do not connect any node to this input.
lastItem = List.LastItem(init)
fitnessFunction = Input()  # Fitness function defined in a DYF node, passed to be evaluated by genetic algorithm.

# group: Assigning fitness function values to generation individuals, if not assigned yet (applies to initial population).
getPopulation = GeneticAlgorithms.Populations.GetPopulation(lastItem)
getCurrentGeneration = GeneticAlgorithms.Populations.GetCurrentGeneration(getPopulation)
chromosomesWithNoFitness = GeneticAlgorithms.Populations.ChromosomesWithNoFitness(getCurrentGeneration)
isEmpty = List.IsEmpty(chromosomesWithNoFitness)
# note: To avoid extra time processing fitness function for the chromosomes with already assigned fitness, the actual fitness function body is overwritten with Object.Identity in this step.
# Function.Apply receives then both: Object.Identity as func parameter and an empty list as arg1 parameter. Object.Identity is responsible for passing an object with no change, therefore the empty list is returned.
identity = Object.Identity()  # unwired: arg0
if_ = If(test=isEmpty, true=identity, false=fitnessFunction)
decodeChromosome = GeneticAlgorithms.Chromosomes.DecodeChromosome(chromosomesWithNoFitness)
apply = ApplyFunction(if_, decodeChromosome)  # "Function.Apply"

# group: 1. Receiving a genetic algorithm instance that stores the whole population, 2. Producing offsprings (selection, crossover and mutation operators applied), 3. Returning list of parents (with known fitness) and new offsprings (new members), 4. Evaluating fitness value for the new members, 5. Passing both parrents and offsprings with their fitness to finish new generation.
produceOffsprings = GeneticAlgorithms.Basic.ProduceOffsprings(lastItem, apply)
decodeChromosome_2 = GeneticAlgorithms.Chromosomes.DecodeChromosome(produceOffsprings.out1)
apply_2 = ApplyFunction(fitnessFunction, decodeChromosome_2)  # "Function.Apply"
produceNewGeneration = GeneticAlgorithms.Basic.ProduceNewGeneration(lastItem, produceOffsprings.out0, produceOffsprings.out1, apply_2)

# group: Checking for loop termination: a) Genetic algorithm termination conditions met, or, b) Unhandled error occured.
hasFinished = GeneticAlgorithms.Basic.HasFinished(produceNewGeneration)
isNull = Object.IsNull(produceNewGeneration)
or_ = Or(hasFinished, isNull)
not_ = Not(or_)

create = List.Create(not_, produceNewGeneration)
loopBody = Output(create)  # LoopBody output function to be passed to a LoopWhile node.
