# Dynamo graph Evo. DiagonalProblem.dyn (Dynamo 1.3.3.4111)

# group: Creating a chromosome pattern: maxHeight and maxWidth numbers define the size of the rectangle.
# note: PROBLEM DESCRIPTION
# The purpose of this sample is to find the start and end points of the longest line that can fit in a rectangle of a given height and width.
# Such the trivial problem has a natural solution in the form of a diagonal of the rectangle, however the genetic algorithm itself has no idea about the geometrical background of the problem.
# The idea is to generate random solution candidates. Each candidate consists of four numbers: X1 and Y1 for the start point and X2 and Y2 for the end point. For each set a fitness function value is evaluated. The fitness function is an Euclidean distance function that should be maximized.
# The genetic algorithm will try to find the solution by operating on the sets and function results only, manipulating them iteratively. In fact, it has no even access to the fitness function body. Instead, it utilizes raw results the function returns for provided solution candidates.
minHeight = DoubleInput(0)
minWidth = DoubleInput(0)
# note: Detailed description of the sample is included in the Evo package folder, by default:
# %APPDATA%\Dynamo\Dynamo Core [or Dynamo Revit]\1.3 [or 2.0]\packages\Evo\extra
# Look for: Evo Specification. First Steps.pdf
# note: Evo   Genetic Algorithms for Dynamo
#    2019
# Created by: Marcin Jasiński
# marcin.jasinski@polsl.pl
# Silesian University of Technology
# Department of Mechanics and Bridges
# Gliwice, Poland
# Repository: github.com/majasinski/Evo
create = List.Create(minHeight, minWidth, minHeight, minWidth)
maxHeight = DoubleInput(600)
maxWidth = DoubleInput(900)
create_2 = List.Create(maxHeight, maxWidth, maxHeight, maxWidth)
fractionDigits = DoubleInput(0)
create_3 = List.Create(fractionDigits, fractionDigits, fractionDigits, fractionDigits)
createBinaryChromosome = GeneticAlgorithms.Chromosomes.CreateBinaryChromosome(create, create_2, create_3)

# group: Generating initial population of the given size.
size = DoubleInput(50)
trackingStrategy = GeneticAlgorithms.PopulationStrategies.TrackingStrategy()
generatePopulation = GeneticAlgorithms.Populations.GeneratePopulation(size, createBinaryChromosome, trackingStrategy)

# note: Members of the initial population are obtained here and passed to the fitness function to:
# a) check if the fitness function works correctly,
# b) get a reference material to compare with the final solution.
getInitialGeneration = GeneticAlgorithms.Populations.GetInitialGeneration(generatePopulation)
chromosomes = GeneticAlgorithms.Populations.Chromosomes(getInitialGeneration)
distanceBetweenPoints = Custom[DistanceBetweenPoints](candidate=chromosomes)  # Calculates distance between points cooridnates.

# group: Creating a genetic algorithm instance. Default operators are used. The core of the solution is the built-in LoopWhile node that iterates the genetic algorithm instance and produces new generations basing on Evo.LoopBody.
createGeneticAlgorithm = GeneticAlgorithms.Basic.CreateGeneticAlgorithm(generatePopulation)
init = Custom[Evo.Init](algorithm=createGeneticAlgorithm)  # Creates init input for evaluation of genetic algorithms using LoopWhile node and Evo package.
continueWhile = Custom[Evo.ContinueWhile]()  # Termines evaluation of genetic algorithm if termination conditions are met.; unwired: init
distanceBetweenPoints_2 = Custom[DistanceBetweenPoints]()  # unwired: candidate
loopBody = Custom[Evo.LoopBody](fitnessFunction=distanceBetweenPoints_2)  # Definition of evaluation body for a genetic algorithm instance, iterated by LoopWhile and Evo package.; unwired: init
loopWhile = LoopWhile(init, continueWhile, loopBody)

# group: Obtaining the best solution. Calculating the line length for the best solution.
lastItem = List.LastItem(loopWhile)
timeEvolving = GeneticAlgorithms.Basic.TimeEvolving(lastItem)
getPopulation = GeneticAlgorithms.Populations.GetPopulation(lastItem)
getCurrentGeneration = GeneticAlgorithms.Populations.GetCurrentGeneration(getPopulation)
bestChromosome = GeneticAlgorithms.Populations.BestChromosome(getCurrentGeneration)
numberOfGenerations = GeneticAlgorithms.Populations.NumberOfGenerations(lastItem)
