# Dynamo graph Evo. AckleyFunction.dyn (Dynamo 1.3.4.6666)

# group: Creating a chromosome pattern: the minimum of the Ackley function is looked within the square range of values: -100.0 to 100.0.
# note: PROBLEM DESCRIPTION
# The Ackley function is a non-convex, two-variable function used as a performance test for optimization algorithms, originally proposed by David Ackley in 1987.
# The function is characterized by numerous local optima and only one global minimum at f(0, 0) = 0.
# The point of the sample is to find the global minimum. Considering the fact the implemented solution is designed to look for maxima, original Ackley function result is multiplied by -1.
min = DoubleInput(100)
# note: Detailed description of the sample is included in the Evo package folder, by default:
# %APPDATA%\Dynamo\Dynamo Core [or Dynamo Revit]\1.3 [or 2.0]\packages\Evo\extra
# Look for: Evo Specification. First Steps.pdf
# note: Evo   Genetic Algorithms for Dynamo
#    2019
# Created by: Marcin Jasiński
# marcin.jasinski@polsl.pl
# Silesian University of Technology
# Department of Mechanics and Bridges
# Gliwice, Poland
# Repository: github.com/majasinski/Evo
create = List.Create(min, min)
max = DoubleInput(-100)
create_2 = List.Create(max, max)
createDoubleChromosome = GeneticAlgorithms.Chromosomes.CreateDoubleChromosome(create, create_2)

# group: Generating initial population of the given size.
size = DoubleInput(100)
trackingStrategy = GeneticAlgorithms.PopulationStrategies.TrackingStrategy()
generatePopulation = GeneticAlgorithms.Populations.GeneratePopulation(size, createDoubleChromosome, trackingStrategy)

# note: Members of the initial population are obtained here and passed to the fitness function to:
# a) check if the fitness function works correctly,
# b) get a reference material to compare with the final solution.
getInitialGeneration = GeneticAlgorithms.Populations.GetInitialGeneration(generatePopulation)
chromosomes = GeneticAlgorithms.Populations.Chromosomes(getInitialGeneration)
ackleyFunction = Custom[AckleyFunction](candidate=chromosomes)  # A non-convex Ackley function.

# group: Creating a genetic algorithm instance. The core of the solution is the built-in LoopWhile node that iterates the genetic algorithm instance and produces new generations basing on Evo.LoopBody.
tournamentSelection = GeneticAlgorithms.Selections.TournamentSelection()
simulatedBinaryCrossover = GeneticAlgorithms.Crossovers.SimulatedBinaryCrossover()
polynomialMutation = GeneticAlgorithms.Mutations.PolynomialMutation()
number = DoubleInput(0.5)
number_2 = DoubleInput(0.01)
createGeneticAlgorithm = GeneticAlgorithms.Basic.CreateGeneticAlgorithm(generatePopulation, tournamentSelection, simulatedBinaryCrossover, polynomialMutation, arg5=size, arg6=number, arg7=number_2)
init = Custom[Evo.Init](algorithm=createGeneticAlgorithm)  # Creates init input for evaluation of genetic algorithms using LoopWhile node and Evo package.
continueWhile = Custom[Evo.ContinueWhile]()  # Termines evaluation of genetic algorithm if termination conditions are met.; unwired: init
ackleyFunction_2 = Custom[AckleyFunction]()  # unwired: candidate
loopBody = Custom[Evo.LoopBody](fitnessFunction=ackleyFunction_2)  # Definition of evaluation body for a genetic algorithm instance, iterated by LoopWhile and Evo package.; unwired: init
loopWhile = LoopWhile(init, continueWhile, loopBody)

# group: Obtaining the best solution. Calculating the minimum value.
lastItem = List.LastItem(loopWhile)
timeEvolving = GeneticAlgorithms.Basic.TimeEvolving(lastItem)
getPopulation = GeneticAlgorithms.Populations.GetPopulation(lastItem)
getProgressiveGenerations = GeneticAlgorithms.Populations.GetProgressiveGenerations(getPopulation)
bestChromosome = GeneticAlgorithms.Populations.BestChromosome(getProgressiveGenerations)
identity = Object.Identity(bestChromosome.out1)
getCurrentGeneration = GeneticAlgorithms.Populations.GetCurrentGeneration(getPopulation)
bestChromosome_2 = GeneticAlgorithms.Populations.BestChromosome(getCurrentGeneration)
numberOfGenerations = GeneticAlgorithms.Populations.NumberOfGenerations(lastItem)
