# Dynamo custom node DistanceBetweenPoints.dyf (Dynamo 1.3.3.4111)
# category: Evo.GeneticAlgorithms
# Calculates distance between points cooridnates.

candidate = Input()  # A solution candidate.
number = DoubleInput(0)
list_getitematindex_x1 = List.GetItemAtIndex(list=candidate@L2, index=number)
number_2 = DoubleInput(2)
list_getitematindex_x2 = List.GetItemAtIndex(list=candidate@L2, index=number_2)
sub = list_getitematindex_x1 - list_getitematindex_x2
number_3 = DoubleInput(2)
pow = Math.Pow(number=sub, power=number_3)
number_4 = DoubleInput(1)
list_getitematindex_y1 = List.GetItemAtIndex(list=candidate@L2, index=number_4)
number_5 = DoubleInput(3)
list_getitematindex_y2 = List.GetItemAtIndex(list=candidate@L2, index=number_5)
sub_2 = list_getitematindex_y1 - list_getitematindex_y2
pow_2 = Math.Pow(number=sub_2, power=number_3)
add = pow + pow_2
sqrt = Math.Sqrt(add)
distance = Output(sqrt)  # Distance between coordinates within the solution candidate.
